# Grasshopper definition DOME LANCET ARCH.gh (Grasshopper 0.9.76)

tangent_rotation = Slider(20, range=0..360)
pivot_rotation = Slider(42.336, range=0..360)
height = Slider(4, range=0..50)
radius = Slider(2, range=0..50)
petals = Slider(20, range=2..100)
base_center = Point(Point(20, 19, 0))

# ---- group: Height point
Z = UnitZ(Factor=height)
move = Move(Geometry=base_center, Motion=Z)  # -> Geometry, Transform

# ---- group: Base points list
circle = CircleCNR(Center=base_center, Normal=Vector(0, 0, 1), Radius=radius)
divide = DivideCurve(Curve=circle, Count=petals, Kinks=False)  # -> Points, Tangents, Parameters

# ----
rad = Radians(Degrees=tangent_rotation)

# ---- group: Shifted points list
shift = ShiftList(List=divide.Points, Shift=1, Wrap=True)

# ---- group: Dome axis
ln = Line(StartPoint=move.Geometry, EndPoint=base_center)

# ---- group: Petal arcs list
ln_2 = Line(StartPoint=base_center, EndPoint=divide.Points)
pl = ConstructPlane(Origin=base_center, XAxis=ln_2, YAxis=ln)
rotate = Rotate(Geometry=ln_2, Angle=rad, Plane=pl)  # -> Geometry, Transform
arc = ArcSED(Start=move.Geometry, End=divide.Points, Direction=rotate.Geometry)  # -> Arc, Plane, Radius

# ---- group: Pivot axes list
ln_3 = Line(StartPoint=divide.Points, EndPoint=shift)

# ---- group: Petals list
arc_2 = ArcSED(Start=divide.Points, End=shift, Direction=divide.Tangents)  # -> Arc, Plane, Radius
railrev = RailRevolution(Curve=arc.Arc, Rail=arc_2.Arc, Axis=ln, Scale=False)

# ---- group: Full dome
rad_2 = Radians(Degrees=pivot_rotation)
rotax = RotateAxis(Geometry=railrev, Angle=rad_2, Axis=ln_3)  # -> Geometry, Transform
