# Grasshopper definition DOME LIST MANIP.gh (Grasshopper 0.9.76)

pivot_rotation = Slider(70.042, range=0..360)
height = Slider(28.67, range=0..50)
radius = Slider(38.253, range=0..50)
petals = Slider(14, range=2..100)
base_center = Point(Point(0, 0, 0))

# ---- group: Height point
Z = UnitZ(Factor=height)
move = Move(Geometry=base_center, Motion=Z)  # -> Geometry, Transform

# ---- group: Base points list
circle = CircleCNR(Center=base_center, Normal=Vector(0, 0, 1), Radius=radius)
divide = DivideCurve(Curve=circle, Count=petals, Kinks=False)  # -> Points, Tangents, Parameters

# ---- group: Shifted points list
shift = ShiftList(List=divide.Points, Shift=1, Wrap=True)

# ---- group: Petal arcs list
ln = Line(StartPoint=base_center, EndPoint=divide.Points)
arc = ArcSED(Start=move.Geometry, End=divide.Points, Direction=ln)  # -> Arc, Plane, Radius

# ---- group: Dome axis
ln_2 = Line(StartPoint=move.Geometry, EndPoint=base_center)

# ---- group: Petals list
arc_2 = ArcSED(Start=divide.Points, End=shift, Direction=divide.Tangents)  # -> Arc, Plane, Radius
railrev = RailRevolution(Curve=arc.Arc, Rail=arc_2.Arc, Axis=ln_2, Scale=False)

# ---- group: Pivot axis list
ln_3 = Line(StartPoint=divide.Points, EndPoint=shift)

# ---- group: Full dome
rad = Radians(Degrees=pivot_rotation)
rotax = RotateAxis(Geometry=railrev, Angle=rad, Axis=ln_3)  # -> Geometry, Transform
