# Grasshopper definition cupula (fluxo de dados).gh (Grasshopper 0.8.66)

altura = Slider(28.67, range=0..50)
rotação = Slider(70.042, range=0..360)
raio = Slider(38.253, range=0..50)
pétalas = Slider(14, range=2..100)
pt = Point(Point(0, 0, 0))
Z = UnitZ(Factor=altura)
circle = CircleCNR(Center=pt, Normal=Vector(0, 0, 1), Radius=raio)
move = Move(Geometry=pt, Motion=Z)  # -> Geometry, Transform
divide = DivideCurve(Curve=circle, Count=pétalas, Kinks=False)  # -> Points, Tangents, Parameters
shift = ShiftList(List=divide.Points, Shift=1, Wrap=True)
ln = Line(StartPoint=move.Geometry, EndPoint=pt)
ln_2 = Line(StartPoint=pt, EndPoint=divide.Points)
arc = ArcSED(Start=move.Geometry, End=divide.Points, Direction=ln_2)  # -> Arc, Plane, Radius
ln_3 = Line(StartPoint=divide.Points, EndPoint=shift)
arc_2 = ArcSED(Start=divide.Points, End=shift, Direction=divide.Tangents)  # -> Arc, Plane, Radius
rad = Radians(Degrees=rotação)
railrev = RailRevolution(Curve=arc.Arc, Rail=arc_2.Arc, Axis=ln, Scale=False)
rotax = RotateAxis(Geometry=railrev, Angle=rad, Axis=ln_3)  # -> Geometry, Transform
