# Grasshopper definition cupula inclinada.gh (Grasshopper 0.9.75)

# ---- group: INPUTS
pivot_rotation_angle = Slider(58.632, range=0..360)
inclination = Slider(28.59, range=0..90)
pt = Point(Point(0, 0, 0))
height = Slider(17.213, range=0..50)
petals = Slider(15, range=2..100)
base_radius = Slider(4.965, range=0..50)

# ---- group: SPHERE CENTER
Z = UnitZ(Factor=height)
X = UnitX(Factor=base_radius)
move = Move(Geometry=pt, Motion=X)  # -> Geometry, Transform
move_2 = Move(Geometry=pt, Motion=Z)  # -> Geometry, Transform
ln = Line(StartPoint=move_2.Geometry, EndPoint=move.Geometry)
curvepoint = PointOnCurve(ln, parameter=0.5)
ln_2 = Line(StartPoint=move_2.Geometry, EndPoint=pt)
Y = UnitY(Factor=1)
pl = PlaneNormal(Origin=curvepoint, ZAxis=Y)
rad = Radians(Degrees="90")
rotate = Rotate(Geometry=ln, Angle=rad, Plane=pl)  # -> Geometry, Transform
llx = LineLine(Line1=ln_2, Line2=rotate.Geometry)  # -> ParamA, ParamB, PointA, PointB

# ---- group: SPHERE AXIS and RADIUS
rad_2 = Radians(Degrees=inclination)
Y_2 = UnitY(Factor=1)
rot3d = Rotate3D(Geometry=move_2.Geometry, Angle=rad_2, Center=llx.PointA, Axis=Y_2)  # -> Geometry, Transform
ln_3 = Line(StartPoint=rot3d.Geometry, EndPoint=llx.PointA)
len = Length(Curve=ln_3)

# ---- group: TRIMING OBJECTS
multiplication = Multiplication(A=len, B=2)
Z_2 = UnitZ(Factor=multiplication)
circle = CircleCNR(Center=pt, Normal=ln_2, Radius=multiplication)
neg = Negative(Value=Z_2)
extr = Extrude(Base=circle, Direction=neg)
cap = CapHoles(Brep=extr)

# ---- group: PETALS
circle_2 = CircleCNR(Center=llx.PointA, Normal=ln_3, Radius=len)
divide = DivideCurve(Curve=circle_2, Count=petals, Kinks=False)  # -> Points, Tangents, Parameters
move_3 = Move(Geometry=llx.PointA, Motion=ln_3)  # -> Geometry, Transform
shift = ShiftList(List=divide.Points, Shift=1, Wrap=True)
ln_4 = Line(StartPoint=llx.PointA, EndPoint=divide.Points)
arc = ArcSED(Start=rot3d.Geometry, End=move_3.Geometry, Direction=ln_4)  # -> Arc, Plane, Radius
arc_2 = ArcSED(Start=divide.Points, End=shift, Direction=divide.Tangents)  # -> Arc, Plane, Radius
railrev = RailRevolution(Curve=arc.Arc, Rail=arc_2.Arc, Axis=ln_3, Scale=False)
trim = TrimSolid(Shape=railrev, Cutters=cap)  # -> flatten(Result)

# ---- group: PIVOT AXIS
circle_3 = CircleCNR(Center=pt, Normal=Vector(0, 0, 1), Radius=base_radius)
ccx = CurveCurve(CurveA=arc.Arc, CurveB=circle_3)  # -> flatten(Points), ParamsA, ParamsB
shift_2 = ShiftList(List=ccx.Points, Shift=1, Wrap=True)
ln_5 = Line(StartPoint=shift_2, EndPoint=ccx.Points)

# ---- group: PIVOT ROTATION
rad_3 = Radians(Degrees=pivot_rotation_angle)
rotax = RotateAxis(Geometry=trim, Angle=rad_3, Axis=ln_5)  # -> Geometry, Transform
