# Grasshopper definition cupula uma pétala.gh (Grasshopper 0.9.76)

pivot_rotation = Slider(57.921, range=0..360)
height = Slider(11.745, range=0..50)
petals = Slider(18, range=2..100)
radius = Slider(21.222, range=0..50)
base_center = Point(Point(0, 0, 0))

# ---- group: Petal angle
pi = Pi(Factor=1)
multiplication = Multiplication(A=pi, B="2")
division = Division(A=multiplication, B=petals)

# ---- group: Height point
Z = UnitZ(Factor=height)
move = Move(Geometry=base_center, Motion=Z)  # -> Geometry, Transform

# ---- group: Ponit on the base
X = UnitX(Factor=radius)
move_2 = Move(Geometry=base_center, Motion=X)  # -> Geometry, Transform

# ---- group: Dome axis
ln = Line(StartPoint=base_center, EndPoint=move.Geometry)

# ---- group: Pivot axis
rotax = RotateAxis(Geometry=move_2.Geometry, Angle=division, Axis=ln)  # -> Geometry, Transform
ln_2 = Line(StartPoint=move_2.Geometry, EndPoint=rotax.Geometry)

# ---- group: Petal arch
ln_3 = Line(StartPoint=base_center, EndPoint=move_2.Geometry)
arc = ArcSED(Start=move.Geometry, End=move_2.Geometry, Direction=ln_3)  # -> Arc, Plane, Radius

# ---- group: Petal
revsrf = Revolution(Curve=arc.Arc, Axis=ln, Domain=division)

# ---- group: Pivoting the petal
rad = Radians(Degrees=pivot_rotation)
rotax_2 = RotateAxis(Geometry=revsrf, Angle=rad, Axis=ln_2)  # -> Geometry, Transform

# ---- group: Full dome
arrpolar = PolarArray(Geometry=rotax_2.Geometry, Plane=base_center, Count=petals, Angle=6.283185307)  # -> Geometry, Transform
