# Grasshopper definition sierpinski2D.gh (Grasshopper 0.9.56)
# plug-ins: HoopSnake

# ---- group: Gerando o Triangulo Inicial
xy = XYPlane(Origin=Point(0, 0, 0))
número_de_lados_do_poligono = Panel("3")
rad = Radians(Degrees=Slider(90, range=0..360))
rotate = Rotate(Geometry=xy, Angle=rad, Plane=xy)  # -> Geometry, Transform
polygon = Polygon(Plane=rotate.Geometry, Radius=Slider(10, range=1..50), Segments=número_de_lados_do_poligono, FilletRadius=0)  # -> Polygon, Length
boundary = BoundarySurfaces(Edges=polygon.Polygon)

# ---- group: Iterações
iterações = Slider(4, range=1..10)

# ---- group: Escala de Redução
fator_de_escala = Panel("0.5")

# ---- group: Iterações (continued)
hs = HoopSnake(
    StartingData=boundary,
    Data=scale.Geometry,
    TerminationCondition=iterações,
    Hoopsnake_Data_dataLimit=2147483647,
    Hoopsnake_Data_resetCounter=True,
    Hoopsnake_Data_updateView=True,
    Hoopsnake_Data_autoUpdate=True)  # -> Feedback, FeedbackHistory, LoopsCounter, IterationsCounter

# ---- group: Escala de Redução (continued)
debrep = DeconstructBrep(Brep=hs.Feedback)  # -> Faces, Edges, Vertices
scale = Scale(Geometry=hs.Feedback, Center=debrep.Vertices, Factor=fator_de_escala)  # -> graft(Geometry), Transform
